# Grasshopper definition GH_Code_Gen_Opt_Floor.gh (Grasshopper 1.0.7)
# plug-ins: Human, DendroGH

box = CenterBox(Base=PlaneXY(0, 0, 0), X=Slider(0.5, range=0..1), Y=Slider(0.5, range=0..1), Z=Slider(0.22, range=0..1))
# Branch version of GH Code Gen
# Target: Floor generation
# Date: 2023.04.10
# Author: Jeremy
# Global Var for GH
panel = Panel("D:\M.Arch\2023Spr\DesignClass_ComputationalDesignandHigh-performance3DPrintingConstruction\Spgrid_topo_opt\spgrid\data\")
# 04 Add BC
number_slider = Slider(0.43, range=-0.5..0.5)
# 01 Initialize
version = Slider(0, range=0..100)
n = Slider(300, range=0..2000)
volumn_fraction = Slider(0.12, range=0..1)
narrow_band = BooleanToggle(True)
grid_update_start_defaut_5 = Slider(5, range=0..10)
fix_cells_near_force_default_false = BooleanToggle(True)
fix_cells_at_dirichlet_default_false = BooleanToggle(True)
progressive_vol_frac_default_0_0 = Slider(0, range=0..5)
fixed_cell_density = Slider(0.5, range=0..1)
# 02 Import Mesh
var_name = Panel("tex")
file_name = Panel("floor_test3.obj")
scale = Slider(1, range=0..1)
translate = Panel("(0.5,0.5,0.5)")
connectivity_filtering_default_true = BooleanToggle(True)
adaptive = BooleanToggle(False)  # disabled
scale_2 = Slider(0.9, range=0..1)  # disabled
var_name_2 = Panel("tex_shell")  # disabled
file_name_2 = Panel("wing_2.obj")  # disabled
translate_2 = Panel("(0.5,0.5,0.5)")  # disabled
adaptive_2 = BooleanToggle(False)

# ---- group: view output
# 查看运行结果
number_slider_2 = Slider(800, range=0..2000)
panel_2 = Panel("rhino导入fbx模型后接入Geo电池，A=运算的网格精度 * 10")
geo = Geometry(<mesh referenced from the Rhino model>)
division = Division(A=number_slider_2, B="-2")
vec = VectorXYZ(XComponent=division, YComponent=division, ZComponent=division)  # -> Vector, Length
pt = ConstructPoint(XCoordinate=0, YCoordinate=0, ZCoordinate=0)
move = Move(Geometry=geo, Motion=vec.Vector)  # -> Geometry, Transform
one_over_x = OneOverX(Value=number_slider_2)
scale_3 = Scale(Geometry=move.Geometry, Center=pt, Factor=one_over_x)  # -> Geometry, Transform

# ----
# 05 Add Load
number_slider_3 = Slider(-10000, range=-10000..10000)
xy = XYPlane(Origin=Point(0, 0, 0))
# 06 Run
optimize = GhPythonScript()  # -> script
# ---------- optimize: Python ----------
__author__ = "Administrator"
__version__ = "2023.04.10"

import rhinoscriptsyntax as rs

script = "\n# Optimize\nopt.run()\n"
# ---------- end optimize ----------
series = Series(Start=0, Step="pi/2", Count="4")
neg = Negative(Value=number_slider)
number_slider_4 = Slider(0.001, range=0..1)  # disabled
pt_2 = ConstructPoint(XCoordinate=Slider(0.5, range=-0.5..0.5), YCoordinate=neg, ZCoordinate=Slider(0.18, range=-0.5..0.5))
pt_3 = ConstructPoint(XCoordinate=number_slider, YCoordinate=Slider(-0.5, range=-0.5..0.5), ZCoordinate=Slider(-0.5, range=-0.5..0.5))
remote_model_path = FilePath("projects/spgrid/data/")
local_model_path = FilePath(panel)
# 03 Populate Grid
local_model_path_2 = FilePath(local_model_path)  # disabled
local_model_path_3 = FilePath(local_model_path)
number_slider_5 = Slider(0.1, range=0..0.5)  # disabled
number_slider_6 = Slider(0.1, range=0..0.5)  # disabled
number_slider_7 = Slider(0.4, range=0..0.5)  # disabled
pt_4 = ConstructPoint(
    XCoordinate=Slider(-0.48, range=-0.5..0.5),
    YCoordinate=Slider(-0.48, range=-0.5..0.5),
    ZCoordinate=Slider(-0.48, range=-0.5..0.5))
pt_5 = ConstructPoint(
    XCoordinate=Slider(0.48, range=-0.5..0.5),
    YCoordinate=Slider(0.48, range=-0.5..0.5),
    ZCoordinate=Slider(0.48, range=-0.5..0.5))
vec_2 = VectorXYZ(XComponent=0, YComponent=0, ZComponent=number_slider_3)  # -> Vector, Length
init = GhPythonScript(
    version=version,
    res=n,
    volume_fraction=volumn_fraction,
    narrow_band=narrow_band,
    grid_update_start=grid_update_start_defaut_5,
    fix_cells_near_force=fix_cells_near_force_default_false,
    fix_cells_at_dirichlet=fix_cells_at_dirichlet_default_false,
    progressive_vol_frac=progressive_vol_frac_default_0_0,
    connectivity_filtering=connectivity_filtering_default_true,
    fixed_cell_density=fixed_cell_density)  # -> script
# ---------- init: Python ----------
__author__ = "Administrator"
__version__ = "2023.04.10"

import rhinoscriptsyntax as rs

script = "from topo_opt import TopoOpt\nimport taichi as tc\n\n"
script += "# Initialize\n"
script += "version = {0}\n".format(version)
script += "n = {0}\n".format(res)
script += "volume_fraction = {0}\n".format(volume_fraction)
script += "narrow_band = {0}\n".format(narrow_band)

script += "\n"

script += "opt = TopoOpt("
script += "res=(n,n,n),"
script += "version=version,"
script += "volume_fraction=volume_fraction,"
script += "grid_update_start={0} if narrow_band else 1000000,".format(grid_update_start)
script += "fix_cells_near_force={0},".format(fix_cells_near_force)
script += "fix_cells_at_dirichlet={0},".format(fix_cells_at_dirichlet)
script += "progressive_vol_frac={0},".format(progressive_vol_frac)
script += "connectivity_filtering={0},".format(connectivity_filtering)
script += "fixed_cell_density={0},".format(fixed_cell_density)

if script.endswith(","):
    script = script[0:-1]  # get rid of comma
script += ")\n"


script += "\n\n"
# ---------- end init ----------
import_mesh = IMPORT_MESH(
    name=var_name,
    filename=file_name,
    scale=scale,
    translate=translate,
    adaptive=adaptive_2,
    mirror="xy",
    relay=local_model_path_3)  # -> script, tex, geo
pt_6 = Point(pt_2)
pt_7 = Point(pt_3)
box_2 = Box2Pt(PointA=pt_7, PointB=pt_6, Plane=PlaneXY(0, 0, 0))
rotate = Rotate(Geometry=box_2, Angle=series, Plane=xy)  # -> Geometry, Transform
box2boundpt = Box2BoundPt(B=rotate.Geometry)  # -> R, R_2
import_mesh_2 = IMPORT_MESH(name=var_name_2, filename=file_name_2, scale=scale_2, translate=translate_2, adaptive=adaptive, relay=local_model_path_2)  # -> script, tex, geo; disabled
pop_mesh = GhPythonScript(tex=import_mesh.tex)  # -> out, script
# ---------- pop_mesh: Python ----------
__author__ = "Administrator"
__version__ = "2023.04.10"

import rhinoscriptsyntax as rs

script = ""
script += "opt.populate_grid(domain_type='texture', tex_id={0}.id)".format(tex)

script += "\n\n"
# ---------- end pop_mesh ----------
make_shell = GhPythonScript(tex=import_mesh_2.tex)  # -> out, script; disabled
# ---------- make_shell: Python ----------
__author__ = "Administrator"
__version__ = "2023.04.10"

import rhinoscriptsyntax as rs

script = ""
script += "opt.general_action(action='make_shell', tex_id={0}.id)".format(tex)

script += "\n\n"
# ---------- end make_shell ----------
vsettings = CreateSettings(VoxelSize=number_slider_4, Bandwidth=1, Isovalue=0, Adaptivity=0.1)  # disabled

# ---- group: 不要超过该边界
box_3 = CenterBox(Base=PlaneXY(0, 0, 0), X="0.5", Y="0.5", Z="0.5")
bd = BrepWireframe(Brep=box_3, Density=-1)
previewlw = CustomPreviewLineweights(Geometry=bd, Shader=ColourSwatch(SwatchColor=RGB(0, 0, 0)), Thickness=Slider(2, range=0..10), Absolute=False)

# ----
pt_8 = Point(box2boundpt.R)
pt_9 = Point(box2boundpt.R_2)
vmesh = MeshToVolume(Mesh=import_mesh.geo, Settings=vsettings)  # disabled
box_bc = BOX_BC(bound0=pt_8, bound1=pt_9, axis_to_fit="xyz")  # -> geo, R
add_plane_load = ADD_PLANE_LOAD(force=vec_2.Vector, axis=Slider(2, range=0..2), extreme=Slider(-1, range=-1..1), bound1=pt_4, bound2=pt_5)  # -> script, geo
vec_3 = VectorXYZ(XComponent=number_slider_5, YComponent=number_slider_6, ZComponent=number_slider_7)  # -> Vector, Length; disabled
panel_3 = Panel("xz")  # disabled
mvolume = VolumeToMesh(Volume=vmesh, VolumeSettings=vsettings)  # disabled
pop_box = GhPythonScript(size=vec_3.Vector, mirror=panel_3)  # -> out, size, script; inputs size: Vector3d; disabled
# ---------- pop_box: Python ----------
__author__ = "Administrator"
__version__ = "2023.04.10"

import rhinoscriptsyntax as rs

script = ""
script += "opt.populate_grid(domain_type='box', size=({0}, {1}, {2}), mirror='{3}')".format(size[0], size[1],size[2],mirror)

script += "\n\n"
# ---------- end pop_box ----------
previewmat = CustomPreviewMaterials(Geometry=box_bc.geo, DiffuseColor=RGB(255, 225, 0), Transparency=0.5)
previewmat_2 = CustomPreviewMaterials(Geometry=add_plane_load.geo, DiffuseColor=RGB(133, 167, 255), Transparency=0.5)
panel_4 = Panel(init)
panel_5 = Panel(import_mesh_2.script)  # disabled
panel_6 = Panel(pop_mesh.script)
panel_7 = Panel(make_shell.script)  # disabled
panel_8 = Panel(add_plane_load.script)
panel_9 = Panel(optimize)
panel_10 = Panel(import_mesh.script)
panel_11 = Panel(box_bc.R)
item = ListItem(List=bd, Index=0, Wrap=True)
panel_12 = Panel(pop_box.script)

# ---- group: preview
size = Vector(pop_box.size)  # disabled
box_4 = Box2Pt(PointA=size, PointB=expr("-x", size), Plane=PlaneXY(0, 0, 0))  # disabled

# ----
divide = DivideCurve(Curve=item, Count=n, Kinks=False)  # -> Points, Tangents, Parameters
pt_10 = Point("-0.48, -0.48, -0.48")
merge = Merge(
    Data1=init,
    Data2=import_mesh.script,
    Data3=import_mesh_2.script,
    Data4=pop_mesh.script,
    Data5=make_shell.script,
    Data6=box_bc.R,
    Data7=add_plane_load.script,
    Data8=optimize)
# right click, copy data only
join = TextJoin(Text=merge)
# Copy Code
output = Panel(join)

# ==== cluster IMPORT_MESH
relay = ClusterInput()
name = ClusterInput()
filename = ClusterInput()
scale = ClusterInput()
translate = ClusterInput()
adaptive = ClusterInput()
mirror = ClusterInput()
tc_texture = GhPythonScript(name=name, filename=filename, scale=scale, translate=translate, adaptive=adaptive, mirror=mirror)  # -> out, script, tex, filename
# ---------- tc_texture: Python ----------
__author__ = "Administrator"
__version__ = "2023.04.10"

import rhinoscriptsyntax as rs

remote_data_path = "projects/spgrid/data/"
tex = name

script = ""
script += "{0} = tc.Texture(".format(name)
script += "'mesh',"
script += "translate={0},".format(translate)
script += "scale=({0}, {0}, {0}),".format(scale)
script += "adaptive={0},".format(adaptive)
script += "filename='{0}',".format(remote_data_path+filename)
if str(mirror) is not 'None' and str(mirror) is not '':
    script += "mirror='{0}',".format(mirror)

if script.endswith(","):
    script = script[0:-1]  # get rid of comma
script += ")\n"


script += "\n\n"
# ---------- end tc_texture ----------
script = ClusterOutput(tc_texture.script)
tex = ClusterOutput(tc_texture.tex)
python = GhPythonScript(sq_format=translate)  # -> vec_format
# ---------- python: Python ----------
__author__ = "Administrator"
__version__ = "2023.04.10"

import rhinoscriptsyntax as rs
sq_format = sq_format[1:-1]
vec_format = "{"+sq_format+"}"
# ---------- end python ----------
panel = Panel(tc_texture.script)
path_concat = Concatenate(FragmentA=relay, FragmentB=tc_texture.filename)
vec = Vector(python)
pcimportobj = ImportOBJ(File=path_concat, MapYtoZ=False, LastSaveLocalization="zh-Hans,N")
subtraction = Subtraction(A=vec, B="{0.5,0.5,0.5}")
scale_2 = Scale(Geometry=pcimportobj, Center=subtraction, Factor=scale)  # -> Geometry, Transform
geo = ClusterOutput(scale_2.Geometry)

# ==== cluster BOX_BC
bound0 = ClusterInput()
bound1 = ClusterInput()
axis_to_fit = ClusterInput()
box_bc = GhPythonScript(bound0=bound0, bound1=bound1, axis_to_fit=axis_to_fit)  # -> out, script; inputs bound0: Point3d, bound1: Point3d
# ---------- box_bc: Python ----------
__author__ = "Administrator"
__version__ = "2023.04.10"

import rhinoscriptsyntax as rs

x1 = bound0[0]
y1 = bound0[1]
z1 = bound0[2]

x2 = bound1[0]
y2 = bound1[1]
z2 = bound1[2]

if x1 > x2:
    x1, x2 = x2, x1

if y1 > y2:
    y1, y2 = y2, y1
    
if z1 > z2:
    z1, z2 = z2, z1

script = ""
script += "opt.general_action(action='add_box_dirichlet_bc', axis_to_fix='{0}', bound0=({1}, {2}, {3}), bound1=({4}, {5}, {6}))".format(axis_to_fit,x1,y1,z1,x2,y2,z2)

script += "\n\n"
# ---------- end box_bc ----------
join = TextJoin(Text=box_bc.script)  # -> simplify(flatten(Result))

# ---- group: preview
box = Box2Pt(PointA=bound0, PointB=bound1, Plane=PlaneXY(0, 0, 0))

# ----
panel = Panel(join)
R = ClusterOutput(join)
geo = ClusterOutput(box)

# ==== cluster ADD_PLANE_LOAD
force = ClusterInput()
axis = ClusterInput()
extreme = ClusterInput()
bound1 = ClusterInput()
bound2 = ClusterInput()
add_plane_load = GhPythonScript(force=force, axis=axis, extreme=extreme, bound1=bound1, bound2=bound2)  # -> script; inputs force: Vector3d, axis: Int32, extreme: Int32, bound1: Point3d, bound2: Point3d
# ---------- add_plane_load: Python ----------
__author__ = "Administrator"
__version__ = "2023.04.10"

import rhinoscriptsyntax as rs
x1 = bound1[0]
y1 = bound1[1]
z1 = bound1[2]

x2 = bound2[0]
y2 = bound2[1]
z2 = bound2[2]

if x1 > x2:
    x1, x2 = x2, x1

if y1 > y2:
    y1, y2 = y2, y1
    
if z1 > z2:
    z1, z2 = z2, z1
    
script = ""
script += "opt.add_plane_load("
script += "force=({0}, {1}, {2}),".format(force[0],force[1],force[2])
script += "axis={0},".format(axis)
script += "extreme={0},".format(extreme)
script += "bound1=({0}, {1}, {2}),".format(x1,y1,z1)
script += "bound2=({0}, {1}, {2}),".format(x2,y2,z2)


if script.endswith(","):
    script = script[0:-1]  # get rid of comma
script += ")\n"


script += "\n\n"
# ---------- end add_plane_load ----------
box = Box2Pt(PointA=bound1, PointB=bound2, Plane=PlaneXY(0, 0, 0))
geo = ClusterOutput(box)
script = ClusterOutput(add_plane_load)

# ==== cluster Box2BoundPt
B = ClusterInput()
boxprop = BoxProperties(Box=B)  # -> Center, Diagonal, Area, Volume, Degeneracy
division = Division(A=boxprop.Diagonal, B=2)
addition = Addition(A=boxprop.Center, B=division)
subtraction = Subtraction(A=boxprop.Center, B=division)
R = ClusterOutput(addition)
R_2 = ClusterOutput(subtraction)
