# Grasshopper definition GH_Code_Gen_Opt_Floor_CustomHole_0609.gh (Grasshopper 1.0.7)
# plug-ins: Human, DendroGH

frame = Slider(10, range=-1..10)
division = Division(A=frame, B=Slider(10, range=0..1000))
frame_percentage = Number(division)
graph = GraphMapper(
    frame_percentage,
    x0=0,
    x1=1,
    y0=0,
    y1=1,
    container_name="Bezier",
    cpx=[0, 0.2314200997, 0.3405797184, 1],
    cpy=[0, 0.2193179131, 1, 1])
graph_2 = GraphMapper(
    frame_percentage,
    x0=0,
    x1=1,
    y0=0,
    y1=1,
    container_name="Bezier",
    cpx=[0, 0.2314200997, 0.3405797184, 1],
    cpy=[0, 0.2193179131, 1, 1])
dom = ConstructDomain(DomainStart=Slider(0.17, range=0..1), DomainEnd=Slider(0, range=0..1))
dom_2 = ConstructDomain(DomainStart=Slider(0.15, range=0..1), DomainEnd=Slider(0.3, range=0..1))
remap = RemapNumbers(Value=graph, Source=Domain(0, 1), Target=dom)  # -> Mapped, Clipped
remap_2 = RemapNumbers(Value=graph_2, Source=Domain(0, 1), Target=dom_2)  # -> Mapped, Clipped
graph_3 = GraphMapper(
    frame_percentage,
    x0=0,
    x1=1,
    y0=0,
    y1=1,
    container_name="Bezier",
    cpx=[0, 0.2297540158, 0.3405797184, 1],
    cpy=[0, 0, 1, 1])
dom_3 = ConstructDomain(DomainStart=Slider(0.3, range=0..1), DomainEnd=Slider(0.1, range=0..1))
box = CenterBox(Base=PlaneXY(0, 0, 0), X=Slider(0.5, range=0..1), Y=Slider(0.5, range=0..1), Z=Slider(0.22, range=0..1))
remap_3 = RemapNumbers(Value=graph_3, Source=Domain(0, 1), Target=dom_3)  # -> Mapped, Clipped
number_slider = Slider(0.15, range=-0.5..0.5)
yz = YZPlane(Origin=Point(0, 0, 0))
file_name = Panel("floor_test3_result.obj")
# 05 Add Load
number_slider_2 = Slider(10000, range=-10000..10000)
# Branch version of GH Code Gen
# Target: Floor Hole Generation
# Date: 2023.06.09
# Author: Jeremy
# Global Var for GH
panel = Panel("D:\M.Arch\2023Spr\DesignClass_ComputationalDesignandHigh-performance3DPrintingConstruction\Spgrid_topo_opt\spgrid\data\")
pt = ConstructPoint(XCoordinate=Slider(0, range=-0.5..0.5), YCoordinate=Slider(0, range=-0.5..0.5), ZCoordinate=Slider(0, range=0..1))
number_slider_3 = Slider(0.45, range=-0.5..0.5)
boundary_smoothing_iters_default_3 = Slider(3, range=0..100)
# 06 Run
panel_2 = Panel("opt.max_iterations = 21")
# 01 Initialize
version = Slider(0, range=0..100)
n = Slider(200, range=0..2000)
volumn_fraction = Slider(0.17, range=0..1)
narrow_band = BooleanToggle(True)
grid_update_start_defaut_5 = Slider(5, range=0..10)
fix_cells_near_force_default_false = BooleanToggle(False)
fix_cells_at_dirichlet_default_false = BooleanToggle(True)
progressive_vol_frac_default_0_0 = Slider(0, range=0..5)
connectivity_filtering_default_true = BooleanToggle(True)
smoothing_iters_default_1 = Slider(1, range=0..100)
var_name = Panel("tex")
file_name_2 = Panel("floor_test3_result.obj")
scale = Slider(1, range=0..1)
translate = Panel("(0.5,0.5,0.5)")
fixed_cell_density = Slider(0, range=0..1)
# 02 Import Mesh
cg_max_iterations = Slider(50, range=0..1000)
adaptive = BooleanToggle(False)  # disabled
scale_2 = Slider(0.9, range=0..1)  # disabled
var_name_2 = Panel("tex_shell")  # disabled
file_name_3 = Panel("wing_2.obj")  # disabled
translate_2 = Panel("(0.5,0.5,0.5)")  # disabled
# 04 Add BC
number_slider_4 = Slider(0.1, range=0..1)
adaptive_2 = BooleanToggle(False)

# ---- group: view output
# 查看运行结果
number_slider_5 = Slider(4000, range=0..10000)
panel_3 = Panel("rhino导入fbx模型后接入Geo电池，A=运算的网格精度 * 10")
geo = Geometry(<mesh referenced from the Rhino model>)
division_2 = Division(A=number_slider_5, B="-2")
vec = VectorXYZ(XComponent=division_2, YComponent=division_2, ZComponent=division_2)  # -> Vector, Length
pt_2 = ConstructPoint(XCoordinate=0, YCoordinate=0, ZCoordinate=0)
move = Move(Geometry=geo, Motion=vec.Vector)  # -> Geometry, Transform
one_over_x = OneOverX(Value=number_slider_5)
scale_3 = Scale(Geometry=move.Geometry, Center=pt_2, Factor=one_over_x)  # -> Geometry, Transform

# ----
pt_3 = ConstructPoint(
    XCoordinate=Slider(-0.24, range=-0.5..0.5),
    YCoordinate=Slider(-0.5, range=-0.5..0.5),
    ZCoordinate=Slider(0.08, range=-0.5..0.5))
pt_4 = ConstructPoint(
    XCoordinate=Slider(0.24, range=-0.5..0.5),
    YCoordinate=Slider(0.5, range=-0.5..0.5),
    ZCoordinate=Slider(-0.05, range=-0.5..0.5))
optimize = GhPythonScript()  # -> script
# ---------- optimize: Python ----------
__author__ = "Administrator"
__version__ = "2023.04.10"

import rhinoscriptsyntax as rs

script = "\n# Optimize\nopt.run()\n"
# ---------- end optimize ----------
xz = XZPlane(Origin=Point(0, 0, 0))
box_2 = CenterBox(Base=pt, X=remap_3.Mapped, Y=Slider(0.5, range=-0.5..0.5), Z=Slider(0.06, range=-0.5..0.5))
neg = Negative(Value=number_slider_3)
neg_2 = Negative(Value=number_slider_2)
number_slider_6 = Slider(0.001, range=0..1)  # disabled
boxprop = BoxProperties(Box=box_2)  # -> Center, Diagonal, Area, Volume, Degeneracy
panel_4 = Panel("xy")  # disabled
vec_2 = VectorXYZ(XComponent=Slider(0.5, range=0..1), YComponent=Slider(0.5, range=0..1), ZComponent=number_slider_4)  # -> Vector, Length
pt_5 = ConstructPoint(
    XCoordinate=Slider(0.5, range=-0.5..0.5),
    YCoordinate=Slider(-0.45, range=-0.5..0.5),
    ZCoordinate=Slider(0.16, range=-0.5..0.5))
pt_6 = ConstructPoint(XCoordinate=number_slider_3, YCoordinate=Slider(-0.5, range=-0.5..0.5), ZCoordinate=Slider(-0.5, range=-0.5..0.5))
remote_model_path = FilePath("projects/spgrid/data/")
remote_model_path_2 = FilePath(remote_model_path)
concat = Concatenate(FragmentA=remote_model_path_2, FragmentB=file_name)
mesh_normal_force = GhPythonScript(
    mesh_fn=concat,
    magnitude="-1",
    center="(0,0,0)",
    falloff=Slider(5000, range=0..10000),
    maximum_distance=Slider(0.015, range=0..0.1),
    override="(0,0,0)")  # -> script; inputs falloff: Int32; disabled
# ---------- mesh_normal_force: Python ----------
__author__ = "Administrator"
__version__ = "2023.04.13"

import rhinoscriptsyntax as rs

script = ""
script += "opt.general_action(action='add_mesh_normal_force',"
script += "mesh_fn='{0}',".format(mesh_fn)
script += "magnitude={0},".format(magnitude)
script += "center={0},".format(center)
script += "falloff={0},".format(falloff)
script += "maximum_distance={0},".format(maximum_distance)
script += "override={0},".format(override)

if script.endswith(","):
    script = script[0:-1]  # get rid of comma
script += ")\n"


script += "\n\n"
# ---------- end mesh_normal_force ----------
local_model_path = FilePath(panel)
# 03 Populate Grid
local_model_path_2 = FilePath(local_model_path)  # disabled
local_model_path_3 = FilePath(local_model_path)
division_3 = Division(A=boxprop.Diagonal, B=2)
number_slider_7 = Slider(0.1, range=0..0.5)  # disabled
number_slider_8 = Slider(0.1, range=0..0.5)  # disabled
number_slider_9 = Slider(0.4, range=0..0.5)  # disabled
pt_7 = ConstructPoint(
    XCoordinate=Slider(-0.5, range=-0.5..0.5),
    YCoordinate=Slider(-0.5, range=-0.5..0.5),
    ZCoordinate=Slider(-0.5, range=-0.5..0.5))
pt_8 = ConstructPoint(
    XCoordinate=Slider(0.5, range=-0.5..0.5),
    YCoordinate=Slider(0.5, range=-0.5..0.5),
    ZCoordinate=Slider(0.5, range=-0.5..0.5))
vec_3 = VectorXYZ(XComponent=0, YComponent=0, ZComponent=neg_2)  # -> Vector, Length
import_mesh = IMPORT_MESH(name=var_name, filename=file_name_2, scale=scale, translate=translate, adaptive=adaptive_2, relay=local_model_path_3)  # -> script, tex, geo; disabled
pt_9 = Point(pt_5)
init = GhPythonScript(
    version=version,
    res=n,
    volume_fraction=volumn_fraction,
    narrow_band=narrow_band,
    grid_update_start=grid_update_start_defaut_5,
    fix_cells_near_force=fix_cells_near_force_default_false,
    fix_cells_at_dirichlet=fix_cells_at_dirichlet_default_false,
    progressive_vol_frac=progressive_vol_frac_default_0_0,
    connectivity_filtering=connectivity_filtering_default_true,
    fixed_cell_density=fixed_cell_density,
    boundary_smoothing_iters=boundary_smoothing_iters_default_3,
    smoothing_iters=smoothing_iters_default_1,
    cg_max_iterations=cg_max_iterations,
    custom_name="opt_customHole_07_test")  # -> script; inputs boundary_smoothing_iters: Int32, smoothing_iters: Int32, cg_max_iterations: Int32
# ---------- init: Python ----------
__author__ = "Administrator"
__version__ = "2023.04.10"

import rhinoscriptsyntax as rs

script = "from topo_opt import TopoOpt\nimport taichi as tc\n\n"
script += "# Initialize\n"
script += "version = {0}\n".format(version)
script += "n = {0}\n".format(res)
script += "volume_fraction = {0}\n".format(volume_fraction)
script += "narrow_band = {0}\n".format(narrow_band)

script += "\n"

script += "opt = TopoOpt("
script += "res=(n,n,n),"
script += "version=version,"
script += "volume_fraction=volume_fraction,"
script += "grid_update_start={0} if narrow_band else 1000000,".format(grid_update_start)
script += "fix_cells_near_force={0},".format(fix_cells_near_force)
script += "fix_cells_at_dirichlet={0},".format(fix_cells_at_dirichlet)
script += "progressive_vol_frac={0},".format(progressive_vol_frac)
script += "connectivity_filtering={0},".format(connectivity_filtering)
script += "fixed_cell_density={0},".format(fixed_cell_density)
script += "boundary_smoothing_iters={0},".format(boundary_smoothing_iters)
script += "smoothing_iters={0},".format(smoothing_iters)
script += "cg_max_iterations={0},".format(cg_max_iterations)
script += "custom_name='{0}',".format(custom_name.replace(" ", "_"))
if script.endswith(","):
    script = script[0:-1]  # get rid of comma
script += ")\n"


script += "\n\n"
# ---------- end init ----------
pop_mesh = GhPythonScript(tex=import_mesh.tex, mirror=panel_4)  # -> out, script; disabled
# ---------- pop_mesh: Python ----------
__author__ = "Administrator"
__version__ = "2023.04.10"

import rhinoscriptsyntax as rs

script = ""
script += "opt.populate_grid(domain_type='texture', tex_id={0}.id, mirror='{1}')".format(tex,mirror)

script += "\n\n"
# ---------- end pop_mesh ----------
pt_10 = Point(pt_6)
box_3 = Box2Pt(PointA=pt_10, PointB=pt_9, Plane=PlaneXY(0, 0, 0))
mirror = Mirror(Geometry=box_3, Plane=yz)  # -> Geometry, Transform
merge = Merge(Data1=box_3, Data2=mirror.Geometry)
mirror_2 = Mirror(Geometry=merge, Plane=xz)  # -> Geometry, Transform
merge_2 = Merge(Data1=merge, Data2=mirror_2.Geometry)
box_4 = GhPythonScript(size=vec_2.Vector, mirror="xy")  # -> out, size, script; inputs size: Vector3d
# ---------- box_4: Python ----------
__author__ = "Administrator"
__version__ = "2023.04.14"

import rhinoscriptsyntax as rs

script = "opt.populate_grid(domain_type='box', size=({0}, {1}, {2}), mirror='{3}')".format(size[0], size[1], size[2], mirror)
script += "\n\n"
# ---------- end box_4 ----------
box2boundpt = Box2BoundPt(B=merge_2)  # -> R, R_2
import_mesh_2 = IMPORT_MESH(name=var_name_2, filename=file_name_3, scale=scale_2, translate=translate_2, adaptive=adaptive, relay=local_model_path_2)  # -> script, tex, geo; disabled
make_shell = GhPythonScript(tex=import_mesh_2.tex)  # -> out, script; disabled
# ---------- make_shell: Python ----------
__author__ = "Administrator"
__version__ = "2023.04.10"

import rhinoscriptsyntax as rs

script = ""
script += "opt.general_action(action='make_shell', tex_id={0}.id)".format(tex)

script += "\n\n"
# ---------- end make_shell ----------
subtraction = Subtraction(A=boxprop.Center, B=division_3)
pt_11 = Point(subtraction)
addition = Addition(A=boxprop.Center, B=division_3)
pt_12 = Point(addition)
vsettings = CreateSettings(VoxelSize=number_slider_6, Bandwidth=1, Isovalue=0, Adaptivity=0.1)  # disabled
merge_3 = Merge(Data1=panel_2, Data2=optimize)

# ---- group: 不要超过该边界
box_5 = CenterBox(Base=PlaneXY(0, 0, 0), X="0.5", Y="0.5", Z="0.5")
bd = BrepWireframe(Brep=box_5, Density=-1)
previewlw = CustomPreviewLineweights(Geometry=bd, Shader=ColourSwatch(SwatchColor=RGB(0, 0, 0)), Thickness=Slider(2, range=0..10), Absolute=False)

# ----
pt_13 = Point(box2boundpt.R)
pt_14 = Point(box2boundpt.R_2)
add_plane_load = ADD_PLANE_LOAD(force=vec_3.Vector, axis=Slider(2, range=0..2), extreme=Slider(-1, range=-1..1), bound1=pt_7, bound2=pt_8)  # -> script, geo
vec_4 = VectorXYZ(XComponent=number_slider_7, YComponent=number_slider_8, ZComponent=number_slider_9)  # -> Vector, Length; disabled
vmesh = MeshToVolume(Mesh=import_mesh.geo, Settings=vsettings)  # disabled
devec = DeconstructVector(Vector=box_4.size)  # -> XComponent, YComponent, ZComponent
box_bc = BOX_BC(bound0=pt_13, bound1=pt_14, axis_to_fit="xyz")  # -> geo, R
box_bc_2 = BOX_BC(bound0=pt_12, bound1=pt_11)  # -> geo, R
panel_5 = Panel("xz")  # disabled
rec = DataRecorder(pt_12, DataLimit=-10, RecordData=False)
rec_2 = DataRecorder(pt_11, DataLimit=-10, RecordData=False)
panel_6 = Panel(mesh_normal_force)
join = TextJoin(Text=merge_3)
box_6 = CenterBox(Base=PlaneXY(0, 0, 0), X=devec.XComponent, Y=devec.YComponent, Z=devec.ZComponent)
wires = BrepWireframe(Brep=box_bc_2.geo, Density=-1)
pop_box = GhPythonScript(size=vec_4.Vector, mirror=panel_5)  # -> out, size, script; inputs size: Vector3d; disabled
# ---------- pop_box: Python ----------
__author__ = "Administrator"
__version__ = "2023.04.10"

import rhinoscriptsyntax as rs

script = ""
script += "opt.populate_grid(domain_type='box', size=({0}, {1}, {2}), mirror='{3}')".format(size[0], size[1],size[2],mirror)

script += "\n\n"
# ---------- end pop_box ----------
mvolume = VolumeToMesh(Volume=vmesh, VolumeSettings=vsettings)  # disabled
swatch = ColourSwatch(SwatchColor=RGB(0, 221, 255))
wires_2 = BrepWireframe(Brep=box_6, Density=-1)
previewmat = CustomPreviewMaterials(Geometry=box_bc.geo, DiffuseColor=RGB(255, 225, 0), Transparency=0.5)
panel_7 = Panel(join)
previewmat_2 = CustomPreviewMaterials(Geometry=add_plane_load.geo, DiffuseColor=RGB(133, 167, 255), Transparency=0.5)
panel_8 = Panel(add_plane_load.script)
panel_9 = Panel(box_4.script)
panel_10 = Panel(init)
panel_11 = Panel(import_mesh_2.script)  # disabled
panel_12 = Panel(pop_mesh.script)
panel_13 = Panel(make_shell.script)  # disabled
panel_14 = Panel(import_mesh.script)
panel_15 = Panel(box_bc.R)
panel_16 = Panel(rec_2)
panel_17 = Panel(rec)
previewmat_3 = CustomPreviewMaterials(Geometry=box_bc_2.geo, DiffuseColor=swatch, Transparency=0.5)
previewlw_2 = CustomPreviewLineweights(Geometry=wires, Shader=swatch, Absolute=False)
panel_18 = Panel(pop_box.script)

# ---- group: preview
size = Vector(pop_box.size)  # disabled
box_7 = Box2Pt(PointA=size, PointB=expr("-x", size), Plane=PlaneXY(0, 0, 0))  # disabled

# ----
panel_19 = Panel(box_bc_2.R)
item = ListItem(List=bd, Index=0, Wrap=True)
divide = DivideCurve(Curve=item, Count=n, Kinks=False)  # -> Points, Tangents, Parameters
pt_15 = Point("-0.48, -0.48, -0.48")
# right click, copy data only
merge_4 = Merge(
    Data1=init,
    Data2=import_mesh.script,
    Data3=import_mesh_2.script,
    Data4=pop_mesh.script,
    Data5=make_shell.script,
    Data6=box_4.script,
    Data7=box_bc.R,
    Data8=box_bc_2.R,
    Data10=add_plane_load.script,
    Data11=mesh_normal_force,
    Data12=join)
join_2 = TextJoin(Text=merge_4)
# Copy Code
output = Panel(join_2)

# ==== cluster IMPORT_MESH
relay = ClusterInput()
name = ClusterInput()
filename = ClusterInput()
scale = ClusterInput()
translate = ClusterInput()
adaptive = ClusterInput()
tc_texture = GhPythonScript(name=name, filename=filename, scale=scale, translate=translate, adaptive=adaptive)  # -> out, script, tex, filename
# ---------- tc_texture: Python ----------
__author__ = "Administrator"
__version__ = "2023.04.10"

import rhinoscriptsyntax as rs

remote_data_path = "projects/spgrid/data/"
tex = name

script = ""
script += "{0} = tc.Texture(".format(name)
script += "'mesh',"
script += "translate={0},".format(translate)
script += "scale=({0}, {0}, {0}),".format(scale)
script += "adaptive={0},".format(adaptive)
script += "filename='{0}',".format(remote_data_path+filename)

if script.endswith(","):
    script = script[0:-1]  # get rid of comma
script += ")\n"


script += "\n\n"
# ---------- end tc_texture ----------
script = ClusterOutput(tc_texture.script)
tex = ClusterOutput(tc_texture.tex)
python = GhPythonScript(sq_format=translate)  # -> vec_format
# ---------- python: Python ----------
__author__ = "Administrator"
__version__ = "2023.04.10"

import rhinoscriptsyntax as rs
sq_format = sq_format[1:-1]
vec_format = "{"+sq_format+"}"
# ---------- end python ----------
panel = Panel(tc_texture.script)
path_concat = Concatenate(FragmentA=relay, FragmentB=tc_texture.filename)
vec = Vector(python)
pcimportobj = ImportOBJ(File=path_concat, MapYtoZ=False, LastSaveLocalization="zh-Hans,N")
subtraction = Subtraction(A=vec, B="{0.5,0.5,0.5}")
scale_2 = Scale(Geometry=pcimportobj, Center=subtraction, Factor=scale)  # -> Geometry, Transform
geo = ClusterOutput(scale_2.Geometry)

# ==== cluster BOX_BC
bound0 = ClusterInput()
bound1 = ClusterInput()
axis_to_fit = ClusterInput()
box_bc = GhPythonScript(bound0=bound0, bound1=bound1, axis_to_fit=axis_to_fit)  # -> out, script; inputs bound0: Point3d, bound1: Point3d
# ---------- box_bc: Python ----------
__author__ = "Administrator"
__version__ = "2023.04.10"

import rhinoscriptsyntax as rs

x1 = bound0[0]
y1 = bound0[1]
z1 = bound0[2]

x2 = bound1[0]
y2 = bound1[1]
z2 = bound1[2]

if x1 > x2:
    x1, x2 = x2, x1

if y1 > y2:
    y1, y2 = y2, y1
    
if z1 > z2:
    z1, z2 = z2, z1

script = ""
script += "opt.general_action(action='add_box_dirichlet_bc', axis_to_fix='{0}', bound0=({1}, {2}, {3}), bound1=({4}, {5}, {6}))".format(axis_to_fit,x1,y1,z1,x2,y2,z2)

script += "\n\n"
# ---------- end box_bc ----------
join = TextJoin(Text=box_bc.script)  # -> simplify(flatten(Result))

# ---- group: preview
box = Box2Pt(PointA=bound0, PointB=bound1, Plane=PlaneXY(0, 0, 0))

# ----
panel = Panel(join)
R = ClusterOutput(join)
geo = ClusterOutput(box)

# ==== cluster ADD_PLANE_LOAD
force = ClusterInput()
axis = ClusterInput()
extreme = ClusterInput()
bound1 = ClusterInput()
bound2 = ClusterInput()
add_plane_load = GhPythonScript(force=force, axis=axis, extreme=extreme, bound1=bound1, bound2=bound2)  # -> script; inputs force: Vector3d, axis: Int32, extreme: Int32, bound1: Point3d, bound2: Point3d
# ---------- add_plane_load: Python ----------
__author__ = "Administrator"
__version__ = "2023.04.10"

import rhinoscriptsyntax as rs
x1 = bound1[0]
y1 = bound1[1]
z1 = bound1[2]

x2 = bound2[0]
y2 = bound2[1]
z2 = bound2[2]

if x1 > x2:
    x1, x2 = x2, x1

if y1 > y2:
    y1, y2 = y2, y1
    
if z1 > z2:
    z1, z2 = z2, z1
    
script = ""
script += "opt.add_plane_load("
script += "force=({0}, {1}, {2}),".format(force[0],force[1],force[2])
script += "axis={0},".format(axis)
script += "extreme={0},".format(extreme)
script += "bound1=({0}, {1}, {2}),".format(x1,y1,z1)
script += "bound2=({0}, {1}, {2}),".format(x2,y2,z2)


if script.endswith(","):
    script = script[0:-1]  # get rid of comma
script += ")\n"


script += "\n\n"
# ---------- end add_plane_load ----------
box = Box2Pt(PointA=bound1, PointB=bound2, Plane=PlaneXY(0, 0, 0))
geo = ClusterOutput(box)
script = ClusterOutput(add_plane_load)

# ==== cluster Box2BoundPt
B = ClusterInput()
boxprop = BoxProperties(Box=B)  # -> Center, Diagonal, Area, Volume, Degeneracy
division = Division(A=boxprop.Diagonal, B=2)
addition = Addition(A=boxprop.Center, B=division)
subtraction = Subtraction(A=boxprop.Center, B=division)
R = ClusterOutput(addition)
R_2 = ClusterOutput(subtraction)
