# Grasshopper definition GH_Split.gh (Grasshopper 1.0.7)
# plug-ins: Pancake, Kangaroo2 Components, Weaverbird

panel = Panel("D:\M.Arch\2023Spr\DesignClass_ComputationalDesignandHigh-performance3DPrintingConstruction\Spgrid_topo_opt\outputs\floor_gh\task-2023-04-14-01-56-43-r03369__v0_r0800\output\output_full_simplified_50.stl")
path = FilePath(panel)
pcimportfrom = ImportFrom(File=path, LastSaveLocalization="zh-Hans,N")  # -> Geo, Layer, ObjectAttributes
mjoin = MeshJoin(Meshes=pcimportfrom.Geo)
bbox = BoundingBox(Content=mjoin, Plane=PlaneXY(0, 0, 0))  # -> Box, Box_2
boxprop = BoxProperties(Box=bbox.Box)  # -> Center, Diagonal, Area, Volume, Degeneracy
neg = Negative(Value=boxprop.Center)
pdecon = Deconstruct(Point=boxprop.Diagonal)  # -> XComponent, YComponent, ZComponent
move = Move(Geometry=mjoin, Motion=neg)  # -> Geometry, Transform
max = Maximum(A=pdecon.XComponent, B=pdecon.YComponent)
division = Division(A=Slider(900, range=0..1000), B=max)
multiplication = Multiplication(A=division, B="2")
scale = Scale(Geometry=move.Geometry, Center=Point(0, 0, 0), Factor=multiplication)  # -> Geometry, Transform
bbox_2 = BoundingBox(Content=scale.Geometry, Plane=PlaneXY(0, 0, 0))  # -> Box, Box_2
move_2 = Move(Motion=Vector(0, 0, 10))  # -> Geometry, Transform
number_slider = Slider(8, range=0..10)
number_slider_2 = Slider(1, range=0..10)
number_slider_3 = Slider(8, range=0..10)
boxprop_2 = BoxProperties(Box=bbox_2.Box)  # -> Center, Diagonal, Area, Volume, Degeneracy
number_slider_4 = Slider(5, range=0..10)
division_2 = Division(A=boxprop_2.Diagonal, B="2")
pdecon_2 = Deconstruct(Point=division_2)  # -> XComponent, YComponent, ZComponent
division_3 = Division(A=pdecon_2.XComponent, B=number_slider)
division_4 = Division(A=pdecon_2.YComponent, B=number_slider_3)
division_5 = Division(A=pdecon_2.ZComponent, B=number_slider_2)
neg_2 = Negative(Value=pdecon_2.ZComponent)
neg_3 = Negative(Value=pdecon_2.XComponent)
neg_4 = Negative(Value=pdecon_2.YComponent)
addition = Addition(A=neg_3, B=division_3)
addition_2 = Addition(A=neg_4, B=division_4)
addition_3 = Addition(A=neg_2, B=division_5)
series = Series(Start=addition, Step=expr("x*2", division_3), Count=number_slider)
series_2 = Series(Start=addition_2, Step=expr("x*2", division_4), Count=number_slider_3)
series_3 = Series(Start=addition_3, Step=expr("x*2", division_5), Count=number_slider_2)
box = CenterBox(Base=PlaneXY(0, 0, 0), X=division_3, Y=division_4, Z=division_5)
bnd = Bounds(Numbers=series)
bnd_2 = Bounds(Numbers=series_2)
bnd_3 = Bounds(Numbers=series_3)
remap = RemapNumbers(Value=series, Source=bnd, Target=Domain(0, 1))  # -> Mapped, Clipped
remap_2 = RemapNumbers(Value=series_2, Source=bnd_2, Target=Domain(0, 1))  # -> Mapped, Clipped
remap_3 = RemapNumbers(Value=series_3, Source=bnd_3, Target=Domain(0, 1))  # -> Mapped, Clipped
graph = GraphMapper(
    remap.Mapped,
    x0=0,
    x1=1,
    y0=0,
    y1=1,
    container_name="Bezier",
    cpx=[0, 0.2649792731, 0.75, 1],
    cpy=[0, 0.286649406, 0.75, 1])
graph_2 = GraphMapper(
    remap_2.Mapped,
    x0=0,
    x1=1,
    y0=0,
    y1=1,
    A=0.9842868692,
    B=0.01178484813,
    container_name="Linear",
    Graph_x0=0.2424192578,
    Graph_x1=0.75,
    Graph_y0=0.2503949404,
    Graph_y1=0.75)
graph_3 = GraphMapper(
    remap_3.Mapped,
    x0=0,
    x1=1,
    y0=0,
    y1=1,
    A=1,
    B=0,
    container_name="Linear",
    Graph_x0=0.25,
    Graph_x1=0.75,
    Graph_y0=0.25,
    Graph_y1=0.75)
remap_4 = RemapNumbers(Value=graph, Source=Domain(0, 1), Target=bnd)  # -> Mapped, Clipped
X = UnitX(Factor=remap_4.Mapped)
move_3 = Move(Geometry=box, Motion=X)  # -> graft(Geometry), Transform
remap_5 = RemapNumbers(Value=graph_2, Source=Domain(0, 1), Target=bnd_2)  # -> Mapped, Clipped
Y = UnitY(Factor=remap_5.Mapped)
move_4 = Move(Geometry=move_3.Geometry, Motion=Y)  # -> graft(Geometry), Transform
remap_6 = RemapNumbers(Value=graph_3, Source=Domain(0, 1), Target=bnd_3)  # -> Mapped, Clipped
Z = UnitZ(Factor=remap_6.Mapped)
move_5 = Move(Geometry=move_4.Geometry, Motion=Z)  # -> flatten(Geometry), Transform
box_2 = Box()
item = ListItem(List=move_5.Geometry, Index=Slider(9, range=0..100), Wrap=True)
mesh = Mesh(scale.Geometry)
brep = Brep(<brep referenced from the Rhino model>)
mdif = MeshDifference(MeshesA=item, MeshesB=mesh)  # disabled
mint = MeshIntersection(MeshesA=item, MeshesB=mesh)
wbthicken = WeaverbirdsMeshThicken(MeshCurves=mint, Distance=Slider(1, range=0..10), OffsetType=0)
preview = CustomPreview(
    Geometry=mint,
    Material={diffuse=RGB(221, 160, 221), emission=RGB(66, 48, 66), shine=0.5, specular=RGB(255, 255, 255), transparency=0})
mesh_2 = Mesh(mint)  # disabled
facen = FaceNormals(Mesh=mesh_2)  # -> Centers, Normals; disabled
demesh = DeconstructMesh(Mesh=mesh_2)  # -> Vertices, Faces, Colours, Normals; disabled
pdecon_3 = Deconstruct(Point=facen.Centers)  # -> XComponent, YComponent, ZComponent; disabled
bnd_4 = Bounds(Numbers=pdecon_3.ZComponent)  # disabled
number_slider_5 = Slider(9.48, range=0..100)  # disabled
number_slider_6 = Slider(400, range=0..400)  # disabled
number_slider_7 = Slider(1, range=0..1)  # disabled
Z_2 = UnitZ(Factor=1)  # disabled
dedomain = DeconstructDomain(Domain=bnd_4)  # -> Start, End; disabled
number_slider_8 = Slider(-1, range=-1..1)  # disabled
brepinc = PointInBrep(Brep=item, Point=facen.Centers, Strict=True)  # disabled
addition_4 = Addition(A=dedomain.Start, B=number_slider_6)  # disabled
addition_5 = Addition(A=dedomain.Start, B=number_slider_7)  # disabled
addition_6 = Addition(A=dedomain.Start, B=number_slider_5)  # disabled
dprod = DotProduct(VectorA=facen.Normals, VectorB=Z_2, Unitize=False)  # disabled
smaller = SmallerThan(FirstNumber=pdecon_3.ZComponent, SecondNumber=addition_5)  # -> SmallerThan, OrEqualTo; disabled
dispatch = Dispatch(List=demesh.Faces, DispatchPattern=brepinc)  # -> ListA, ListB; disabled
python = GhPythonScript()  # -> Out, A; disabled
larger = LargerThan(FirstNumber=pdecon_3.ZComponent, SecondNumber=addition_6)  # -> LargerThan, OrEqualTo; disabled
smaller_2 = SmallerThan(FirstNumber=pdecon_3.ZComponent, SecondNumber=addition_4)  # -> SmallerThan, OrEqualTo; disabled
larger_2 = LargerThan(FirstNumber=dprod, SecondNumber=number_slider_8)  # -> LargerThan, OrEqualTo; disabled
dispatch_2 = Dispatch(List=demesh.Faces, DispatchPattern=smaller.SmallerThan)  # -> ListA, ListB; disabled
conmesh = ConstructMesh(Vertices=demesh.Vertices, Faces=dispatch.ListA)  # disabled
and = GateAnd(A=larger.LargerThan, B=smaller_2.SmallerThan)  # disabled
clean = CombineClean(Meshes=conmesh)  # disabled
conmesh_2 = ConstructMesh(Vertices=demesh.Vertices, Faces=dispatch_2.ListA)  # disabled
and_2 = GateAnd(A=and, B=larger_2.OrEqualTo)  # disabled
dispatch_3 = Dispatch(List=demesh.Faces, DispatchPattern=and_2)  # -> ListA, ListB; disabled
preview_2 = CustomPreview(
    Geometry=clean,
    Material={diffuse=RGB(221, 160, 221), emission=RGB(66, 48, 66), shine=0.5, specular=RGB(255, 255, 255), transparency=0})  # disabled
conmesh_3 = ConstructMesh(Vertices=demesh.Vertices, Faces=dispatch_3.ListA)  # disabled
popgeo = PopulateGeometry(Geometry=conmesh_3, Count=100, Seed=1)  # disabled
