# Grasshopper definition animation.gh (Grasshopper 1.0.7)
# plug-ins: Human, DendroGH

box = CenterBox(Base=PlaneXY(0, 0, 0), X=Slider(0.5, range=0..1), Y=Slider(0.5, range=0..1), Z=Slider(0.22, range=0..1))
yz = YZPlane(Origin=Point(0, 0, 0))
file_name = Panel("floor_test3_result.obj")
boundary_smoothing_iters_default_3 = Slider(3, range=0..100)
# 05 Add Load
number_slider = Slider(10000, range=-10000..10000)
# Branch version of GH Code Gen
# Target: Floor generation gen2
# Date: 2023.04.13
# Author: Jeremy
# Global Var for GH
panel = Panel("D:\M.Arch\2023Spr\DesignClass_ComputationalDesignandHigh-performance3DPrintingConstruction\Spgrid_topo_opt\spgrid\data\")
smoothing_iters_default_1 = Slider(1, range=0..100)
number_slider_2 = Slider(0.45, range=-0.5..0.5)
# 02 Import Mesh
cg_max_iterations = Slider(300, range=0..1000)
# 01 Initialize
version = Slider(0, range=0..100)
n = Slider(400, range=0..2000)
volumn_fraction = Slider(0.2, range=0..1)
narrow_band = BooleanToggle(True)
grid_update_start_defaut_5 = Slider(5, range=0..10)
fix_cells_near_force_default_false = BooleanToggle(True)
fix_cells_at_dirichlet_default_false = BooleanToggle(True)
progressive_vol_frac_default_0_0 = Slider(0, range=0..5)
var_name = Panel("tex")
file_name_2 = Panel("floor_test3_result.obj")
scale = Slider(1, range=0..1)
translate = Panel("(0.5,0.5,0.5)")
connectivity_filtering_default_true = BooleanToggle(True)
fixed_cell_density = Slider(1, range=0..1)
adaptive = BooleanToggle(False)  # disabled
scale_2 = Slider(0.9, range=0..1)  # disabled
var_name_2 = Panel("tex_shell")  # disabled
file_name_3 = Panel("wing_2.obj")  # disabled
translate_2 = Panel("(0.5,0.5,0.5)")  # disabled
# 04 Add BC
number_slider_3 = Slider(0.05, range=0..1)
adaptive_2 = BooleanToggle(False)
series = Series(Start=0, Step="pi/2", Count=Slider(4, range=0..10))

# ---- group: view output
# 查看运行结果
number_slider_4 = Slider(4000, range=0..10000)
panel_2 = Panel("rhino导入fbx模型后接入Geo电池，A=运算的网格精度 * 10")
geo = Geometry(<mesh referenced from the Rhino model>)
division = Division(A=number_slider_4, B="-2")
vec = VectorXYZ(XComponent=division, YComponent=division, ZComponent=division)  # -> Vector, Length
pt = ConstructPoint(XCoordinate=0, YCoordinate=0, ZCoordinate=0)
move = Move(Geometry=geo, Motion=vec.Vector)  # -> Geometry, Transform
one_over_x = OneOverX(Value=number_slider_4)
scale_3 = Scale(Geometry=move.Geometry, Center=pt, Factor=one_over_x)  # -> Geometry, Transform

# ----
# 06 Run
optimize = GhPythonScript()  # -> script
# ---------- optimize: Python ----------
__author__ = "Administrator"
__version__ = "2023.04.10"

import rhinoscriptsyntax as rs

script = "\n# Optimize\nopt.run()\n"
# ---------- end optimize ----------
xz = XZPlane(Origin=Point(0, 0, 0))
number_slider_5 = Slider(-0.5, range=-0.5..0.5)  # disabled
number_slider_6 = Slider(0.5, range=-0.5..0.5)  # disabled
number_slider_7 = Slider(-0.05, range=-0.5..0.5)  # disabled
number_slider_8 = Slider(0.5, range=-0.5..0.5)  # disabled
number_slider_9 = Slider(-0.04, range=-0.5..0.5)  # disabled
number_slider_10 = Slider(-0.5, range=-0.5..0.5)  # disabled
neg = Negative(Value=number_slider_2)
number_slider_11 = Slider(0.001, range=0..1)  # disabled
panel_3 = Panel("xy")  # disabled
neg_2 = Negative(Value=number_slider)
vec_2 = VectorXYZ(XComponent=Slider(0.5, range=0..1), YComponent=Slider(0.5, range=0..1), ZComponent=number_slider_3)  # -> Vector, Length
pt_2 = ConstructPoint(
    XCoordinate=Slider(0.5, range=-0.5..0.5),
    YCoordinate=Slider(-0.45, range=-0.5..0.5),
    ZCoordinate=Slider(0.05, range=-0.5..0.5))
pt_3 = ConstructPoint(XCoordinate=number_slider_2, YCoordinate=Slider(-0.5, range=-0.5..0.5), ZCoordinate=Slider(-0.5, range=-0.5..0.5))
pt_4 = ConstructPoint(
    XCoordinate=Slider(0.5, range=-0.5..0.5),
    YCoordinate=Slider(-0.5, range=-0.5..0.5),
    ZCoordinate=Slider(0.05, range=-0.5..0.5))
pt_5 = ConstructPoint(
    XCoordinate=Slider(0.49, range=-0.5..0.5),
    YCoordinate=Slider(0.5, range=-0.5..0.5),
    ZCoordinate=Slider(-0.05, range=-0.5..0.5))
remote_model_path = FilePath("projects/spgrid/data/")
remote_model_path_2 = FilePath(remote_model_path)
concat = Concatenate(FragmentA=remote_model_path_2, FragmentB=file_name)
mesh_normal_force = GhPythonScript(
    mesh_fn=concat,
    magnitude="-1",
    center="(0,0,0)",
    falloff=Slider(5000, range=0..10000),
    maximum_distance=Slider(0.015, range=0..0.1),
    override="(0,0,0)")  # -> script; inputs falloff: Int32; disabled
# ---------- mesh_normal_force: Python ----------
__author__ = "Administrator"
__version__ = "2023.04.13"

import rhinoscriptsyntax as rs

script = ""
script += "opt.general_action(action='add_mesh_normal_force',"
script += "mesh_fn='{0}',".format(mesh_fn)
script += "magnitude={0},".format(magnitude)
script += "center={0},".format(center)
script += "falloff={0},".format(falloff)
script += "maximum_distance={0},".format(maximum_distance)
script += "override={0},".format(override)

if script.endswith(","):
    script = script[0:-1]  # get rid of comma
script += ")\n"


script += "\n\n"
# ---------- end mesh_normal_force ----------
local_model_path = FilePath(panel)
# 03 Populate Grid
local_model_path_2 = FilePath(local_model_path)  # disabled
local_model_path_3 = FilePath(local_model_path)
number_slider_12 = Slider(0.1, range=0..0.5)  # disabled
number_slider_13 = Slider(0.1, range=0..0.5)  # disabled
number_slider_14 = Slider(0.4, range=0..0.5)  # disabled
pt_6 = ConstructPoint(
    XCoordinate=Slider(-0.5, range=-0.5..0.5),
    YCoordinate=Slider(-0.5, range=-0.5..0.5),
    ZCoordinate=Slider(0.04, range=-0.5..0.5))
pt_7 = ConstructPoint(
    XCoordinate=Slider(0.5, range=-0.5..0.5),
    YCoordinate=Slider(0.5, range=-0.5..0.5),
    ZCoordinate=Slider(0.07, range=-0.5..0.5))
vec_3 = VectorXYZ(XComponent=0, YComponent=0, ZComponent=neg_2)  # -> Vector, Length
pt_8 = ConstructPoint(XCoordinate=number_slider_8, YCoordinate=number_slider_10, ZCoordinate=number_slider_9)  # disabled
pt_9 = ConstructPoint(XCoordinate=number_slider_5, YCoordinate=number_slider_6, ZCoordinate=number_slider_7)  # disabled
init = GhPythonScript(
    version=version,
    res=n,
    volume_fraction=volumn_fraction,
    narrow_band=narrow_band,
    grid_update_start=grid_update_start_defaut_5,
    fix_cells_near_force=fix_cells_near_force_default_false,
    fix_cells_at_dirichlet=fix_cells_at_dirichlet_default_false,
    progressive_vol_frac=progressive_vol_frac_default_0_0,
    connectivity_filtering=connectivity_filtering_default_true,
    fixed_cell_density=fixed_cell_density,
    boundary_smoothing_iters=boundary_smoothing_iters_default_3,
    smoothing_iters=smoothing_iters_default_1,
    cg_max_iterations=cg_max_iterations,
    custom_name="topbc0.01_frac0.2_r400_mirror_zReverse")  # -> script; inputs boundary_smoothing_iters: Int32, smoothing_iters: Int32, cg_max_iterations: Int32
# ---------- init: Python ----------
__author__ = "Administrator"
__version__ = "2023.04.10"

import rhinoscriptsyntax as rs

script = "from topo_opt import TopoOpt\nimport taichi as tc\n\n"
script += "# Initialize\n"
script += "version = {0}\n".format(version)
script += "n = {0}\n".format(res)
script += "volume_fraction = {0}\n".format(volume_fraction)
script += "narrow_band = {0}\n".format(narrow_band)

script += "\n"

script += "opt = TopoOpt("
script += "res=(n,n,n),"
script += "version=version,"
script += "volume_fraction=volume_fraction,"
script += "grid_update_start={0} if narrow_band else 1000000,".format(grid_update_start)
script += "fix_cells_near_force={0},".format(fix_cells_near_force)
script += "fix_cells_at_dirichlet={0},".format(fix_cells_at_dirichlet)
script += "progressive_vol_frac={0},".format(progressive_vol_frac)
script += "connectivity_filtering={0},".format(connectivity_filtering)
script += "fixed_cell_density={0},".format(fixed_cell_density)
script += "boundary_smoothing_iters={0},".format(boundary_smoothing_iters)
script += "smoothing_iters={0},".format(smoothing_iters)
script += "cg_max_iterations={0},".format(cg_max_iterations)
script += "custom_name='{0}',".format(custom_name.replace(" ", "_"))
if script.endswith(","):
    script = script[0:-1]  # get rid of comma
script += ")\n"


script += "\n\n"
# ---------- end init ----------
import_mesh = IMPORT_MESH(name=var_name, filename=file_name_2, scale=scale, translate=translate, adaptive=adaptive_2, relay=local_model_path_3)  # -> script, tex, geo; disabled
pt_10 = Point(pt_2)
pop_mesh = GhPythonScript(tex=import_mesh.tex, mirror=panel_3)  # -> out, script; disabled
# ---------- pop_mesh: Python ----------
__author__ = "Administrator"
__version__ = "2023.04.10"

import rhinoscriptsyntax as rs

script = ""
script += "opt.populate_grid(domain_type='texture', tex_id={0}.id, mirror='{1}')".format(tex,mirror)

script += "\n\n"
# ---------- end pop_mesh ----------
pt_11 = Point(pt_3)
box_2 = Box2Pt(PointA=pt_11, PointB=pt_10, Plane=PlaneXY(0, 0, 0))
mirror = Mirror(Geometry=box_2, Plane=yz)  # -> Geometry, Transform
merge = Merge(Data1=box_2, Data2=mirror.Geometry)
mirror_2 = Mirror(Geometry=merge, Plane=xz)  # -> Geometry, Transform
merge_2 = Merge(Data1=merge, Data2=mirror_2.Geometry)
pt_12 = Point(pt_4)
box_3 = GhPythonScript(size=vec_2.Vector, mirror="xy")  # -> out, size, script; inputs size: Vector3d
# ---------- box_3: Python ----------
__author__ = "Administrator"
__version__ = "2023.04.14"

import rhinoscriptsyntax as rs

script = "opt.populate_grid(domain_type='box', size=({0}, {1}, {2}), mirror='{3}')".format(size[0], size[1], size[2], mirror)
script += "\n\n"
# ---------- end box_3 ----------
pt_13 = Point(pt_5)
box_4 = Box2Pt(PointA=pt_13, PointB=pt_12, Plane=PlaneXY(0, 0, 0))
rotate = Rotate(Geometry=box_4, Angle=series, Plane=PlaneXY(0, 0, 0))  # -> Geometry, Transform
item = ListItem(List=rotate.Geometry, Index=0, Wrap=True)
box2boundpt = Box2BoundPt(B=merge_2)  # -> R, R_2
box2boundpt_2 = Box2BoundPt(B=rotate.Geometry)  # -> R, R_2
import_mesh_2 = IMPORT_MESH(name=var_name_2, filename=file_name_3, scale=scale_2, translate=translate_2, adaptive=adaptive, relay=local_model_path_2)  # -> script, tex, geo; disabled
make_shell = GhPythonScript(tex=import_mesh_2.tex)  # -> out, script; disabled
# ---------- make_shell: Python ----------
__author__ = "Administrator"
__version__ = "2023.04.10"

import rhinoscriptsyntax as rs

script = ""
script += "opt.general_action(action='make_shell', tex_id={0}.id)".format(tex)

script += "\n\n"
# ---------- end make_shell ----------
vsettings = CreateSettings(VoxelSize=number_slider_11, Bandwidth=1, Isovalue=0, Adaptivity=0.1)  # disabled
pt_14 = Point(pt_9)  # disabled
pt_15 = Point(pt_8)  # disabled

# ---- group: 不要超过该边界
box_5 = CenterBox(Base=PlaneXY(0, 0, 0), X="0.5", Y="0.5", Z="0.5")
bd = BrepWireframe(Brep=box_5, Density=-1)
previewlw = CustomPreviewLineweights(Geometry=bd, Shader=ColourSwatch(SwatchColor=RGB(0, 0, 0)), Thickness=Slider(2, range=0..10), Absolute=False)

# ----
pt_16 = Point(box2boundpt.R)
pt_17 = Point(box2boundpt.R_2)
pt_18 = Point(box2boundpt_2.R)
pt_19 = Point(box2boundpt_2.R_2)
panel_4 = Panel("")  # disabled
add_plane_load = ADD_PLANE_LOAD(force=vec_3.Vector, axis=Slider(2, range=0..2), extreme=Slider(-1, range=-1..1), bound1=pt_6, bound2=pt_7)  # -> script, geo
vmesh = MeshToVolume(Mesh=import_mesh.geo, Settings=vsettings)  # disabled
vec_4 = VectorXYZ(XComponent=number_slider_12, YComponent=number_slider_13, ZComponent=number_slider_14)  # -> Vector, Length; disabled
devec = DeconstructVector(Vector=box_3.size)  # -> XComponent, YComponent, ZComponent
box_bc = BOX_BC(bound0=pt_16, bound1=pt_17, axis_to_fit="xyz")  # -> geo, R
box_bc_2 = BOX_BC(bound0=pt_18, bound1=pt_19, axis_to_fit="xy")  # -> geo, R
panel_5 = Panel("xz")  # disabled
panel_6 = Panel(mesh_normal_force)
box_bc_3 = BOX_BC(bound0=pt_14, bound1=pt_15, axis_to_fit=panel_4)  # -> geo, R; disabled
box_6 = CenterBox(Base=PlaneXY(0, 0, 0), X=devec.XComponent, Y=devec.YComponent, Z=devec.ZComponent)
pop_box = GhPythonScript(size=vec_4.Vector, mirror=panel_5)  # -> out, size, script; inputs size: Vector3d; disabled
# ---------- pop_box: Python ----------
__author__ = "Administrator"
__version__ = "2023.04.10"

import rhinoscriptsyntax as rs

script = ""
script += "opt.populate_grid(domain_type='box', size=({0}, {1}, {2}), mirror='{3}')".format(size[0], size[1],size[2],mirror)

script += "\n\n"
# ---------- end pop_box ----------
mvolume = VolumeToMesh(Volume=vmesh, VolumeSettings=vsettings)  # disabled
previewmat = CustomPreviewMaterials(Geometry=box_bc.geo, DiffuseColor=RGB(255, 225, 0), Transparency=0.5)
previewmat_2 = CustomPreviewMaterials(Geometry=add_plane_load.geo, DiffuseColor=RGB(133, 167, 255), Transparency=0.5)
panel_7 = Panel(optimize)
panel_8 = Panel(add_plane_load.script)
panel_9 = Panel(box_3.script)
previewmat_3 = CustomPreviewMaterials(Geometry=box_bc_3.geo, DiffuseColor=RGB(255, 225, 0), Transparency=0.5)  # disabled
panel_10 = Panel(init)
panel_11 = Panel(import_mesh_2.script)  # disabled
panel_12 = Panel(pop_mesh.script)
panel_13 = Panel(make_shell.script)  # disabled
panel_14 = Panel(import_mesh.script)
panel_15 = Panel(box_bc.R)
previewmat_4 = CustomPreviewMaterials(Geometry=box_bc_2.geo, DiffuseColor=RGB(255, 225, 0), Transparency=0.5)
panel_16 = Panel(box_bc_2.R)
panel_17 = Panel(pop_box.script)
item_2 = ListItem(List=bd, Index=0, Wrap=True)

# ---- group: preview
size = Vector(pop_box.size)  # disabled
box_7 = Box2Pt(PointA=size, PointB=expr("-x", size), Plane=PlaneXY(0, 0, 0))  # disabled

# ----
divide = DivideCurve(Curve=item_2, Count=n, Kinks=False)  # -> Points, Tangents, Parameters
pt_20 = Point("-0.48, -0.48, -0.48")
number_slider_15 = Slider(0, range=0..359)
# Copy Code
merge_3 = Merge(
    Data1=init,
    Data2=import_mesh.script,
    Data3=import_mesh_2.script,
    Data4=pop_mesh.script,
    Data5=make_shell.script,
    Data6=box_3.script,
    Data7=box_bc.R,
    Data8=box_bc_2.R,
    Data9=box_bc_3.R,
    Data10=add_plane_load.script,
    Data11=mesh_normal_force,
    Data12=optimize)
box_8 = Box(box_5)
# right click, copy data only
join = TextJoin(Text=merge_3)
output = Panel(join)
number_slider_16 = Slider(0.5, range=0..1)
scale_nu = ScaleNU(Geometry=box_8, Plane="0.0,0.0,0", ScaleX=1, ScaleY=Slider(0, range=0..1), ScaleZ=1)  # -> Geometry, Transform
scale_nu_2 = ScaleNU(Geometry=box_8, Plane="0.0,0.0,0", ScaleX=Slider(0, range=0..1), ScaleY=1, ScaleZ=1)  # -> Geometry, Transform
scale_nu_3 = ScaleNU(Geometry=box_8, Plane="0.5,0.5,0", ScaleX=number_slider_16, ScaleY=number_slider_16, ScaleZ=1)  # -> Geometry, Transform
box_9 = Box(scale_nu.Geometry)
box_10 = Box(scale_nu_2.Geometry)
crv = Curve(bd)
box_11 = Box(box_bc_2.geo)
box_12 = Box(box_6)
box_13 = Box(box_bc.geo)
box_14 = Box(scale_nu_3.Geometry)
box_15 = Box(add_plane_load.geo)
entwine = Entwine(
    Branch00=crv,
    Branch01=box_12,
    Branch02=box_13,
    Branch03=box_11,
    Branch04=box_15,
    Branch05=box_9,
    Branch06=box_10,
    Branch07=box_14,
    FlattenInputs=True)
series_2 = Series(Start=0, Step=1, Count=Slider(3, range=0..10))
rotate_2 = Rotate(Geometry=entwine, Angle=degrees(number_slider_15), Plane=PlaneXY(0, 0, 0))  # -> Geometry, Transform
X = UnitX(Factor=series_2)
series_3 = Series(Start=0, Step=1, Count=Slider(3, range=0..10))
Y = UnitY(Factor=series_3)
bang = ExplodeTree(Data=rotate_2.Geometry)  # -> Branch0, Branch1, Branch2, Branch3, Branch4, Branch5, Branch6, Branch7
series_4 = Series(Start=0, Step="0.5", Count=Slider(4, range=0..10))
box_16 = Box(bang.Branch3)
crv_2 = Curve(bang.Branch0)
box_17 = Box(bang.Branch1)
box_18 = Box(bang.Branch2)
merge_4 = Merge(Data1=box_17, Data2=box_18)  # -> flatten(Result)
sunion = SolidUnion(Breps=merge_4)
move_2 = Move(Geometry=sunion, Motion=X)  # -> Geometry, Transform
move_3 = Move(Geometry=graft(move_2.Geometry), Motion=Y)  # -> Geometry, Transform
Z = UnitZ(Factor=series_4)
box_19 = Box(bang.Branch5)
box_20 = Box(bang.Branch6)
box_21 = Box(bang.Branch7)
box_22 = Box(bang.Branch4)
move_4 = Move(Geometry=graft(move_3.Geometry), Motion=Z)  # -> Geometry, Transform
wires = BrepWireframe(Brep=box_17, Density=-1)
wires_2 = BrepWireframe(Brep=box_18, Density=-1)
previewlw_2 = CustomPreviewLineweights(Geometry=crv_2, Shader=ColourSwatch(SwatchColor=RGB(133, 133, 133)), Thickness=Slider(10, range=0..10), Absolute=False)
previewlw_3 = CustomPreviewLineweights(Geometry=wires_2, Shader=ColourSwatch(SwatchColor=RGB(48, 48, 48)), Thickness=Slider(0, range=0..10), Absolute=False)
previewlw_4 = CustomPreviewLineweights(Geometry=wires, Shader=ColourSwatch(SwatchColor=RGB(48, 48, 48)), Thickness=Slider(0, range=0..10), Absolute=False)
number_slider_17 = Slider(3, range=0..10)
number_slider_18 = Slider(8, range=0..11)
number_slider_19 = Slider(9, range=0..11)
number_slider_20 = Slider(10, range=0..11)
number_slider_21 = Slider(2, range=0..10)
number_slider_22 = Slider(1, range=0..10)
addition = Addition(A="-30", B=number_slider_15)
item_3 = ListItem(List=crv_2, Index=expr("x+4", number_slider_17), Wrap=True)
item_4 = ListItem(List=crv_2, Index=expr("x+1", number_slider_18), Wrap=True)
item_5 = ListItem(List=crv_2, Index=expr("x+1", number_slider_19), Wrap=True)
item_6 = ListItem(List=crv_2, Index=number_slider_17, Wrap=True)
item_7 = ListItem(List=crv_2, Index=number_slider_18, Wrap=True)
item_8 = ListItem(List=crv_2, Index=expr("x+1", number_slider_20), Wrap=True)
item_9 = ListItem(List=crv_2, Index=number_slider_19, Wrap=True)
item_10 = ListItem(List=crv_2, Index=expr("x+4", number_slider_21), Wrap=True)
item_11 = ListItem(List=crv_2, Index=expr("x+4", 0), Wrap=True)
item_12 = ListItem(List=crv_2, Index=number_slider_20, Wrap=True)
item_13 = ListItem(List=crv_2, Index=expr("x+4", number_slider_22), Wrap=True)
item_14 = ListItem(List=crv_2, Index=Slider(8, range=0..11), Wrap=True)
item_15 = ListItem(List=crv_2, Index=number_slider_21, Wrap=True)
item_16 = ListItem(List=crv_2, Index=Slider(11, range=0..11), Wrap=True)
item_17 = ListItem(List=crv_2, Index=Slider(0, range=0..11), Wrap=True)
item_18 = ListItem(List=crv_2, Index=Slider(1, range=0..11), Wrap=True)
item_19 = ListItem(List=crv_2, Index=Slider(2, range=0..11), Wrap=True)
item_20 = ListItem(List=crv_2, Index=Slider(4, range=0..11), Wrap=True)
item_21 = ListItem(List=crv_2, Index=0, Wrap=True)
item_22 = ListItem(List=crv_2, Index=number_slider_22, Wrap=True)
item_23 = ListItem(List=crv_2, Index=Slider(3, range=0..11), Wrap=True)
item_24 = ListItem(List=crv_2, Index=Slider(6, range=0..11), Wrap=True)
item_25 = ListItem(List=crv_2, Index=Slider(5, range=0..11), Wrap=True)
item_26 = ListItem(List=crv_2, Index=Slider(7, range=0..11), Wrap=True)
division_2 = Division(A=addition, B=Slider(4, range=0..10))
int = Integer(division_2)
divide_2 = DivideCurve(Curve=item_19, Count=int, Kinks=False)  # -> Points, Tangents, Parameters
divide_3 = DivideCurve(Curve=item_23, Count=int, Kinks=False)  # -> Points, Tangents, Parameters
divide_4 = DivideCurve(Curve=item_24, Count=int, Kinks=False)  # -> Points, Tangents, Parameters
divide_5 = DivideCurve(Curve=item_26, Count=int, Kinks=False)  # -> Points, Tangents, Parameters
divide_6 = DivideCurve(Curve=item_6, Count=int, Kinks=False)  # -> Points, Tangents, Parameters
divide_7 = DivideCurve(Curve=item_7, Count=int, Kinks=False)  # -> Points, Tangents, Parameters
divide_8 = DivideCurve(Curve=item_3, Count=int, Kinks=False)  # -> Points, Tangents, Parameters
divide_9 = DivideCurve(Curve=item_9, Count=int, Kinks=False)  # -> Points, Tangents, Parameters
divide_10 = DivideCurve(Curve=item_4, Count=int, Kinks=False)  # -> Points, Tangents, Parameters
divide_11 = DivideCurve(Curve=item_14, Count=int, Kinks=False)  # -> Points, Tangents, Parameters
divide_12 = DivideCurve(Curve=item_5, Count=int, Kinks=False)  # -> Points, Tangents, Parameters
divide_13 = DivideCurve(Curve=item_12, Count=int, Kinks=False)  # -> Points, Tangents, Parameters
divide_14 = DivideCurve(Curve=item_16, Count=int, Kinks=False)  # -> Points, Tangents, Parameters
divide_15 = DivideCurve(Curve=item_15, Count=int, Kinks=False)  # -> Points, Tangents, Parameters
divide_16 = DivideCurve(Curve=item_8, Count=int, Kinks=False)  # -> Points, Tangents, Parameters
divide_17 = DivideCurve(Curve=item_17, Count=int, Kinks=False)  # -> Points, Tangents, Parameters
divide_18 = DivideCurve(Curve=item_21, Count=int, Kinks=False)  # -> Points, Tangents, Parameters
divide_19 = DivideCurve(Curve=item_10, Count=int, Kinks=False)  # -> Points, Tangents, Parameters
divide_20 = DivideCurve(Curve=item_22, Count=int, Kinks=False)  # -> Points, Tangents, Parameters
divide_21 = DivideCurve(Curve=item_18, Count=int, Kinks=False)  # -> Points, Tangents, Parameters
divide_22 = DivideCurve(Curve=item_11, Count=int, Kinks=False)  # -> Points, Tangents, Parameters
divide_23 = DivideCurve(Curve=item_20, Count=int, Kinks=False)  # -> Points, Tangents, Parameters
divide_24 = DivideCurve(Curve=item_13, Count=int, Kinks=False)  # -> Points, Tangents, Parameters
divide_25 = DivideCurve(Curve=item_25, Count=int, Kinks=False)  # -> Points, Tangents, Parameters
rev = ReverseList(List=divide_2.Points)
rev_2 = ReverseList(List=divide_3.Points)
rev_3 = ReverseList(List=divide_4.Points)
rev_4 = ReverseList(List=divide_5.Points)
ln = Line(StartPoint=graft(divide_6.Points), EndPoint=graft(divide_8.Points))
ln_2 = Line(StartPoint=graft(divide_7.Points), EndPoint=graft(divide_10.Points))
ln_3 = Line(StartPoint=graft(divide_9.Points), EndPoint=graft(divide_12.Points))
ln_4 = Line(StartPoint=graft(divide_11.Points), EndPoint=graft(divide_14.Points))
ln_5 = Line(StartPoint=graft(divide_13.Points), EndPoint=graft(divide_16.Points))
ln_6 = Line(StartPoint=graft(divide_15.Points), EndPoint=graft(divide_19.Points))
ln_7 = Line(StartPoint=graft(divide_17.Points), EndPoint=graft(rev))
ln_8 = Line(StartPoint=graft(divide_18.Points), EndPoint=graft(divide_22.Points))
ln_9 = Line(StartPoint=graft(divide_20.Points), EndPoint=graft(divide_24.Points))
ln_10 = Line(StartPoint=graft(divide_21.Points), EndPoint=graft(rev_2))
ln_11 = Line(StartPoint=graft(divide_23.Points), EndPoint=graft(rev_3))
ln_12 = Line(StartPoint=graft(divide_25.Points), EndPoint=graft(rev_4))

# ==== cluster IMPORT_MESH
relay = ClusterInput()
name = ClusterInput()
filename = ClusterInput()
scale = ClusterInput()
translate = ClusterInput()
adaptive = ClusterInput()
tc_texture = GhPythonScript(name=name, filename=filename, scale=scale, translate=translate, adaptive=adaptive)  # -> out, script, tex, filename
# ---------- tc_texture: Python ----------
__author__ = "Administrator"
__version__ = "2023.04.10"

import rhinoscriptsyntax as rs

remote_data_path = "projects/spgrid/data/"
tex = name

script = ""
script += "{0} = tc.Texture(".format(name)
script += "'mesh',"
script += "translate={0},".format(translate)
script += "scale=({0}, {0}, {0}),".format(scale)
script += "adaptive={0},".format(adaptive)
script += "filename='{0}',".format(remote_data_path+filename)

if script.endswith(","):
    script = script[0:-1]  # get rid of comma
script += ")\n"


script += "\n\n"
# ---------- end tc_texture ----------
script = ClusterOutput(tc_texture.script)
tex = ClusterOutput(tc_texture.tex)
python = GhPythonScript(sq_format=translate)  # -> vec_format
# ---------- python: Python ----------
__author__ = "Administrator"
__version__ = "2023.04.10"

import rhinoscriptsyntax as rs
sq_format = sq_format[1:-1]
vec_format = "{"+sq_format+"}"
# ---------- end python ----------
panel = Panel(tc_texture.script)
path_concat = Concatenate(FragmentA=relay, FragmentB=tc_texture.filename)
vec = Vector(python)
pcimportobj = ImportOBJ(File=path_concat, MapYtoZ=False, LastSaveLocalization="zh-Hans,N")
subtraction = Subtraction(A=vec, B="{0.5,0.5,0.5}")
scale_2 = Scale(Geometry=pcimportobj, Center=subtraction, Factor=scale)  # -> Geometry, Transform
geo = ClusterOutput(scale_2.Geometry)

# ==== cluster BOX_BC
bound0 = ClusterInput()
bound1 = ClusterInput()
axis_to_fit = ClusterInput()
box_bc = GhPythonScript(bound0=bound0, bound1=bound1, axis_to_fit=axis_to_fit)  # -> out, script; inputs bound0: Point3d, bound1: Point3d
# ---------- box_bc: Python ----------
__author__ = "Administrator"
__version__ = "2023.04.10"

import rhinoscriptsyntax as rs

x1 = bound0[0]
y1 = bound0[1]
z1 = bound0[2]

x2 = bound1[0]
y2 = bound1[1]
z2 = bound1[2]

if x1 > x2:
    x1, x2 = x2, x1

if y1 > y2:
    y1, y2 = y2, y1
    
if z1 > z2:
    z1, z2 = z2, z1

script = ""
script += "opt.general_action(action='add_box_dirichlet_bc', axis_to_fix='{0}', bound0=({1}, {2}, {3}), bound1=({4}, {5}, {6}))".format(axis_to_fit,x1,y1,z1,x2,y2,z2)

script += "\n\n"
# ---------- end box_bc ----------
join = TextJoin(Text=box_bc.script)  # -> simplify(flatten(Result))

# ---- group: preview
box = Box2Pt(PointA=bound0, PointB=bound1, Plane=PlaneXY(0, 0, 0))

# ----
panel = Panel(join)
R = ClusterOutput(join)
geo = ClusterOutput(box)

# ==== cluster ADD_PLANE_LOAD
force = ClusterInput()
axis = ClusterInput()
extreme = ClusterInput()
bound1 = ClusterInput()
bound2 = ClusterInput()
add_plane_load = GhPythonScript(force=force, axis=axis, extreme=extreme, bound1=bound1, bound2=bound2)  # -> script; inputs force: Vector3d, axis: Int32, extreme: Int32, bound1: Point3d, bound2: Point3d
# ---------- add_plane_load: Python ----------
__author__ = "Administrator"
__version__ = "2023.04.10"

import rhinoscriptsyntax as rs
x1 = bound1[0]
y1 = bound1[1]
z1 = bound1[2]

x2 = bound2[0]
y2 = bound2[1]
z2 = bound2[2]

if x1 > x2:
    x1, x2 = x2, x1

if y1 > y2:
    y1, y2 = y2, y1
    
if z1 > z2:
    z1, z2 = z2, z1
    
script = ""
script += "opt.add_plane_load("
script += "force=({0}, {1}, {2}),".format(force[0],force[1],force[2])
script += "axis={0},".format(axis)
script += "extreme={0},".format(extreme)
script += "bound1=({0}, {1}, {2}),".format(x1,y1,z1)
script += "bound2=({0}, {1}, {2}),".format(x2,y2,z2)


if script.endswith(","):
    script = script[0:-1]  # get rid of comma
script += ")\n"


script += "\n\n"
# ---------- end add_plane_load ----------
box = Box2Pt(PointA=bound1, PointB=bound2, Plane=PlaneXY(0, 0, 0))
geo = ClusterOutput(box)
script = ClusterOutput(add_plane_load)

# ==== cluster Box2BoundPt
B = ClusterInput()
boxprop = BoxProperties(Box=B)  # -> Center, Diagonal, Area, Volume, Degeneracy
division = Division(A=boxprop.Diagonal, B=2)
addition = Addition(A=boxprop.Center, B=division)
subtraction = Subtraction(A=boxprop.Center, B=division)
R = ClusterOutput(addition)
R_2 = ClusterOutput(subtraction)
