# Grasshopper definition pipe_generator.gh (Grasshopper 1.0.7)

brep = Brep(<brep referenced from the Rhino model>)
brep_2 = Brep(<brep referenced from the Rhino model>)
brep_3 = Brep(<brep referenced from the Rhino model>)
brep_4 = Brep(<brep referenced from the Rhino model>)
brep_5 = Brep(<brep referenced from the Rhino model>)
brep_6 = Brep(<brep referenced from the Rhino model>)
brep_7 = Brep(<brep referenced from the Rhino model>)
merge = Merge(Data1=brep_7, Data2=brep_4, Data3=brep_6, Data4=brep_2, Data5=brep_5, Data6=brep, Data7=brep_3)
series = Series(Start=0, Step=Slider(90, range=0..100), Count=Slider(4, range=0..10))
crv = Curve(<curve referenced from the Rhino model>)
crv_2 = Curve(<curve referenced from the Rhino model>)
crv_3 = Curve(<curve referenced from the Rhino model>)
Z = UnitZ(Factor=1)
crv_4 = Curve(<curve referenced from the Rhino model>)
rotate = Rotate(Geometry=graft(merge), Angle=degrees(series), Plane=Z)  # -> Geometry, Transform
swp1 = Sweep1(Rail=crv, Sections=crv_2, Miter=1)
swp1_2 = Sweep1(Rail=crv_4, Sections=crv_3, Miter=1)
